# Grasshopper definition Cutting Through ruled surface - WireNCut worshop.gh (Grasshopper 1.0.7)
# plug-ins: Robots

# ----
# 2.Adjusting Tool Path planes -
# Using an external refrenece Point
# to align all planes' normals
number_slider = Slider(616, range=-1000..1000)
pt = ConstructPoint(XCoordinate=Slider(331, range=-1000..1000), YCoordinate=Slider(-144, range=-1000..1000), ZCoordinate=number_slider)

# ----
# 1.Extracting the specific curves  - that
# defines the outer cut of the hot wire
brep = Brep(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)

debrep = DeconstructBrep(Brep=brep)  # -> Faces, Edges, Vertices
item = ListItem(List=debrep.Edges, Index=0, Wrap=True)  # -> Item, Item1
flip = FlipCurve(Curve=item.Item1)  # -> Curve, Flag
rulesrf = RuledSurface(CurveA=item.Item, CurveB=flip.Curve)
range = Range(Domain="0.01 to 0.99", Steps=Slider(17, range=0..100))
pt_2 = ConstructPoint(XCoordinate=range, YCoordinate=Slider(0.5, range=0..1), ZCoordinate=0)
evalsrf = EvaluateSurface(Surface=reparameterize(rulesrf), Point=pt_2)  # -> Point, Normal, UDirection, VDirection, Frame
pln = Plane(evalsrf.Frame)

sph = Sphere(Base=pt, Radius=20)
xy = XYPlane(Origin=pln)
vec2pt = Vector2Pt(PointA=pln, PointB=pt, Unitize=False)  # -> Vector, Length
padjust = AdjustPlane(Plane=xy, Normal=vec2pt.Vector)
prot = RotatePlane(Plane=padjust, Angle=degrees(Slider(-45, range=-100..100)))

pln_2 = Plane(prot)

# ----
# 3.Instancing Robot Targets -
# Approaching target,
# cutting path
# and retreat target
number_slider_2 = Slider(322, range=0..1000)
item_2 = ListItem(List=pln_2, Index="-1", Wrap=True)
Z = UnitZ(Factor=number_slider_2)
move = Move(Geometry=item_2, Motion=Z)  # -> Geometry, Transform
deplane = DeconstructPlane(Plane=move.Geometry)  # -> Origin, XAxis, YAxis, ZAxis
amp = Amplitude(Vector=deplane.ZAxis, Amplitude=Slider(100, range=0..100))
move_2 = Move(Geometry=move.Geometry, Motion=amp)  # -> Geometry, Transform
list = ValueList({"Joint", "Linear"}, selected="Joint")
target = CreateTarget(Plane=move_2.Geometry, Motion=list, Speed="100", Zone="10", IsCartesian=True)

item_3 = ListItem(List=pln_2, Index=0, Wrap=True)
Z_2 = UnitZ(Factor=Slider(100, range=0..100))
move_3 = Move(Geometry=item_3, Motion=Z_2)  # -> Geometry, Transform
list_2 = ValueList({"Joint", "Linear"}, selected="Joint")
target_2 = CreateTarget(Plane=move_3.Geometry, Motion=list_2, Speed="100", Zone="10", IsCartesian=True)

list_3 = ValueList({"Joint", "Linear"}, selected="Linear")
target_3 = CreateTarget(Plane=pln_2, Motion=list_3, Speed="100", Zone="10", IsCartesian=True)

merge = Merge(Data1=flatten(target_2), Data2=flatten(target_3), Data3=flatten(target))
